# Grasshopper definition 221017_unroll_panel+niche.ghx (Grasshopper 1.0.7)
# plug-ins: Human

input = DataInput(
    Destination="/Volumes/GoogleDrive-110500231569640047002/Общие диски/CONTEXTMACHINE/PROJECTS/2202_Lahta_Arc/Lahta Arc_WORK/SF/from_VV/221004_Recess_for_mockup.ghdata",
    RelativePath="/Volumes/GoogleDrive-110500231569640047002/Общие диски/CONTEXTMACHINE/PROJECTS/2202_Lahta_Arc/Lahta Arc_WORK/SF/from_VV/221004_Recess_for_mockup.ghdata|../../../../../../Volumes/GoogleDrive-110500231569640047002/Общие диски/CONTEXTMACHINE/PROJECTS/2202_Lahta_Arc/Lahta Arc_WORK/SF/from_VV/221004_Recess_for_mockup.ghdata",
    UpdateDelay=50000)  # -> Hyp_recess_top, Hyp_recess_Vert_01, Hyp_recess_Vert_02, Hyp_recess_Ribs
input_2 = DataInput(
    Destination="/Volumes/GoogleDrive-110500231569640047002/Общие диски/CONTEXTMACHINE/PROJECTS/2202_Lahta_Arc/Lahta Arc_WORK/SF/from_VV/221004_Recess_for_mockup.ghdata",
    RelativePath="/Volumes/GoogleDrive-110500231569640047002/Общие диски/CONTEXTMACHINE/PROJECTS/2202_Lahta_Arc/Lahta Arc_WORK/SF/from_VV/221004_Recess_for_mockup.ghdata|../../../../../../Volumes/GoogleDrive-110500231569640047002/Общие диски/CONTEXTMACHINE/PROJECTS/2202_Lahta_Arc/Lahta Arc_WORK/SF/from_VV/221004_Recess_for_mockup.ghdata",
    UpdateDelay=50000)  # -> Hyp_recess_top, Hyp_recess_Vert_01, Hyp_recess_Vert_02, Hyp_recess_Ribs
srf = Surface(flatten(input_2.Hyp_recess_top))
srf_2 = Surface(flatten(input_2.Hyp_recess_Vert_01))
srf_3 = Surface(flatten(input_2.Hyp_recess_Vert_02))
srf_4 = Surface(flatten(input.Hyp_recess_Vert_02))
srf_5 = Surface(flatten(input.Hyp_recess_top))
srf_6 = Surface(flatten(input.Hyp_recess_Vert_01))
input_3 = DataInput(
    Destination="/Volumes/GoogleDrive-110500231569640047002/Общие диски/CONTEXTMACHINE/PROJECTS/2202_Lahta_Arc/Lahta Arc_WORK/MP/gh_data/panel_test_2.ghdata",
    RelativePath="/Volumes/GoogleDrive-110500231569640047002/Общие диски/CONTEXTMACHINE/PROJECTS/2202_Lahta_Arc/Lahta Arc_WORK/MP/gh_data/panel_test_2.ghdata|../../../../../../Volumes/GoogleDrive-110500231569640047002/Общие диски/CONTEXTMACHINE/PROJECTS/2202_Lahta_Arc/Lahta Arc_WORK/MP/gh_data/panel_test_2.ghdata",
    UpdateDelay=50000)  # -> Hyp_panels_surf_3, Hyp_panels_surf_6
trim = TrimTree(Tree=input.Hyp_recess_Ribs, Depth=1)
panel = Panel("""301
302
303""")
tstat = TreeStatistics(Tree=trim)  # -> Paths, Length, Count
panel_2 = Panel("""301
302
303""")
trim_2 = TrimTree(Tree=input_2.Hyp_recess_Ribs, Depth=1)
item = ListItem(List=tstat.Paths, Index=panel_2, Wrap=True)
srf_7 = Surface(input_3.Hyp_panels_surf_6)
item_2 = ListItem(List=srf_2, Index=panel, Wrap=True)
item_3 = ListItem(List=srf_3, Index=panel, Wrap=True)
tstat_2 = TreeStatistics(Tree=trim_2)  # -> Paths, Length, Count
input_4 = DataInput(
    Destination="/Volumes/GoogleDrive-110500231569640047002/Общие диски/CONTEXTMACHINE/PROJECTS/2202_Lahta_Arc/Lahta Arc_WORK/MP/gh_data/panel_test_2.ghdata",
    RelativePath="/Volumes/GoogleDrive-110500231569640047002/Общие диски/CONTEXTMACHINE/PROJECTS/2202_Lahta_Arc/Lahta Arc_WORK/MP/gh_data/panel_test_2.ghdata|../../../../../../Volumes/GoogleDrive-110500231569640047002/Общие диски/CONTEXTMACHINE/PROJECTS/2202_Lahta_Arc/Lahta Arc_WORK/MP/gh_data/panel_test_2.ghdata",
    UpdateDelay=50000)  # -> Hyp_panels_surf_3, Hyp_panels_surf_6
item_4 = ListItem(List=srf_6, Index=panel_2, Wrap=True)
branch = TreeBranch(Tree=trim, Path=item, MaintainPaths=True)
item_5 = ListItem(List=srf_4, Index=panel_2, Wrap=True)
item_6 = ListItem(List=srf_5, Index=panel_2, Wrap=True)
panel_3 = Panel("""0
1""")
flip = Flip(Surface=srf_7)  # -> Surface, Result
item_7 = ListItem(List=tstat_2.Paths, Index=panel, Wrap=True)
weave = Weave(Pattern=panel_3, Stream0=item_2, Stream1=item_3, NullGaps=False)
flip_2 = Flip(Surface=item_4)  # -> Surface, Result
flip_3 = Flip(Surface=input_4.Hyp_panels_surf_6)  # -> flatten(Surface), Result
number_slider = Slider(1, range=0..10)
branch_2 = TreeBranch(Tree=trim_2, Path=item_7, MaintainPaths=True)  # -> flatten(Branch)
flip_4 = Flip(Surface=weave)  # -> flatten(Surface), Result
item_8 = ListItem(List=srf, Index=panel, Wrap=True)
flip_5 = Flip(Surface=item_6)  # -> Surface, Result
bang = ExplodeTree(Data=branch)  # -> Branch0, Branch1
flip_6 = Flip(Surface=item_5)  # -> Surface, Result
item_9 = ListItem(List=flip.Surface, Index=0, Wrap=True)  # -> flatten(Item), flatten(Item1)
partition = PartitionList(List=flip_3.Surface, Size=Slider(2, range=0..10))
partition_2 = PartitionList(List=branch_2, Size=Slider(6, range=0..10))
partition_3 = PartitionList(List=flip_4.Surface, Size=Slider(2, range=0..10))
panel_4 = Panel("""0
1
0
1
0
1""")
item_10 = ListItem(List=flip_5.Surface, Index=0, Wrap=True)
item_11 = ListItem(List=flip_2.Surface, Index=0, Wrap=True)
file = ReadFile(File="/Users/sofyadobycina/Documents/GitHub/mmodel/panels_gh/main.py", PerLineParse=False)
item_12 = ListItem(List=flip_6.Surface, Index=0, Wrap=True)
srf_8 = Surface(flatten(flip.Surface))
rotate = Rotate(Geometry=item_9.Item1, Angle=degrees(Slider(180, range=0..1000)), Plane=PlaneXY(0, 0, 0))  # -> Geometry, Transform
item_13 = ListItem(List=srf_8, Index=0, Wrap=True)
file_2 = ReadFile(File="/Users/sofyadobycina/Documents/GitHub/mmodel/panels_gh/main_niche_unroll.py", PerLineParse=False)
python = GhPythonScript(back_side=item_8, niche_side=partition_3, ribs=partition_2, panels=partition)  # -> out, pack; inputs back_side: list of Surface, niche_side: tree of Brep, ribs: tree of Surface, panels: tree of Brep
# ---------- python: Python ----------
__author__ = "sofyadobycina"

import rhinoscriptsyntax as rs
import ghpythonlib.treehelpers as th


panels = th.tree_to_list(panels, lambda x: x[0])
ribs = th.tree_to_list(ribs, lambda x: x[0])
niche_side = th.tree_to_list(niche_side, lambda x: x[0])


pack = []
for p, n, r, b in zip(panels, niche_side, ribs, back_side):
    #r = th.list_to_tree(r)
    pack.append([p[0], p[1], n[0], n[1], r, b])

#pack = th.list_to_tree(pack)

print(pack)
# ---------- end python ----------
python_2 = GhPythonScript(Code=file, Panels=srf_8, Tip=panel_4)  # -> Out, Fres, Cut, Panel
python_3 = GhPythonScript(Code=file_2, Panels_right=item_11, Panels_left=item_12, Rebra=bang.Branch0, Back_side=item_10)  # -> Out, Cut, Fres, A, B
number_slider_2 = Slider(0, range=0..10)
file_3 = ReadFile(File="/Users/sofyadobycina/Documents/GitHub/mmodel/panels_gh/main_niche_unroll.py", PerLineParse=False)
panel_5 = Panel(python.pack)
file_4 = ReadFile(File="/Users/sofyadobycina/Documents/GitHub/mmodel/panels_gh/main.py", PerLineParse=False)
flip_7 = FlipMatrix(Data=python_3.Cut)
file_5 = ReadFile(File="/Users/sofyadobycina/Documents/GitHub/mmodel/panels_gh/unroll_pack.py", PerLineParse=False)
flip_8 = FlipMatrix(Data=python_3.Fres)
flip_9 = FlipMatrix(Data=python_2.Fres)
flip_10 = FlipMatrix(Data=python_2.Cut)
number_slider_3 = Slider(0, range=0..10)
crv = Curve(python_3.B)
python_4 = GhPythonScript(Code=file_3)  # -> Out, Niche_side, Back_niche, Ribs
crv_2 = Curve(python_3.A)
python_5 = GhPythonScript(Code=file_4)  # -> Out, Panel
item_14 = ListItem(List=python.pack, Index=Slider(3, range=0..10), Wrap=True)
number_slider_4 = Slider(2, range=0..10)
item_15 = ListItem(List=crv, Index=Slider(2, range=0..10), Wrap=True)
item_16 = ListItem(List=flip_8, Index=number_slider_2, Wrap=True)
item_17 = ListItem(List=flip_7, Index=number_slider_2, Wrap=True)
item_18 = ListItem(List=flip_9, Index=number_slider_3, Wrap=True)
item_19 = ListItem(List=flip_10, Index=number_slider_3, Wrap=True)
panel_6 = Panel(python_3.A)
item_20 = ListItem(List=python_2.Panel, Index=0, Wrap=True)
python_6 = GhPythonScript(
    Code=file_5,
    Panel=python_5.Panel,
    Niche_side=python_4.Niche_side,
    Back_niche=python_4.Back_niche,
    Ribs=python_4.Ribs,
    Unroll_elems=item_14)  # -> Out, Pack_unrolls, Packs
previewlw = CustomPreviewLineweights(Geometry=item_17, Shader=ColourSwatch(SwatchColor=RGB(255, 254, 254)), Thickness=number_slider_4, Absolute=False)
previewlw_2 = CustomPreviewLineweights(Geometry=item_16, Shader=ColourSwatch(SwatchColor=RGB(255, 0, 0)), Thickness=number_slider_4, Absolute=False)
previewlw_3 = CustomPreviewLineweights(Geometry=item_19, Shader=ColourSwatch(SwatchColor=RGB(178, 255, 0)), Thickness=Slider(2, range=0..10), Absolute=False)
previewlw_4 = CustomPreviewLineweights(Geometry=item_18, Shader=ColourSwatch(SwatchColor=RGB(255, 0, 0)), Thickness=Slider(2, range=0..10), Absolute=False)
bang_2 = ExplodeTree(Data=python_6.Pack_unrolls)  # -> _0000, _0001, _0010, _0011, _0020, _0021, _0022, _0030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
group = Group(Objects=[bang_2._0000, bang_2._0001])  # -> flatten(Group)
group_2 = Group(Objects=[bang_2._0010, bang_2._0011])  # -> flatten(Group)
group_3 = Group(Objects=[bang_2.Branch10, bang_2.Branch11])  # -> flatten(Group)
group_4 = Group(Objects=[bang_2._0032, bang_2._0031, bang_2._0030])  # -> flatten(Group)
group_5 = Group(Objects=[bang_2._0022, bang_2._0021, bang_2._0020])  # -> flatten(Group)
item_21 = ListItem(List=group_4, Index=0, Wrap=True)  # -> Item, Item1, Item2
number_slider_5 = Slider(45, range=0..100)
number_slider_6 = Slider(45, range=0..100)
previewlw_5 = CustomPreviewLineweights(Geometry=item_21.Item2, Shader=ColourSwatch(SwatchColor=RGB(191, 255, 0)), Thickness=2, Absolute=False)
previewlw_6 = CustomPreviewLineweights(Geometry=item_21.Item1, Shader=ColourSwatch(SwatchColor=RGB(255, 0, 0)), Thickness=2, Absolute=False)
previewlw_7 = CustomPreviewLineweights(Geometry=item_21.Item, Shader=ColourSwatch(SwatchColor=RGB(255, 255, 255)), Thickness=2, Absolute=False)
python_7 = GhPythonScript(panel=item_20, niche=number_slider_6, bottom=number_slider_6, top=Slider(35, range=0..100))  # -> out, a, flatten(frame)
# ---------- python_7: Python ----------
__author__ = "sofyadobycina"

import rhinoscriptsyntax as rs
import Rhino.Geometry as rh
import math

def offset(crv, ofs_dist, extend=None):
    c = rh.Curve.Offset(crv, rh.Plane.WorldXY, ofs_dist, 0.01, rh.CurveOffsetCornerStyle.Sharp)[0]
    if extend is not None:
        c = rh.Curve.Extend(c, rh.Interval(extend[0], extend[1]))
    return c
    
def bound_rec(crv):
    join = rh.Curve.JoinCurves(crv)[0]
    bound_rec = rh.PolyCurve.GetBoundingBox(join, rh.Plane.WorldXY)
    return bound_rec
    
def intersect(values):
    res = []
    for i, v in enumerate(values):
        param = []
        for ind, val in enumerate(values):
            if i != ind:
                inters = rs.CurveCurveIntersection(v, val)
                if inters is not None:
                    param.append(inters[0][5])
        param = sorted(param)
        if len(param) != 1 and i!=0:
            trimed = rh.Curve.Trim(v, param[0], param[1])
        elif i==3:
            trimed = rh.Curve.Trim(v, v.Domain[0], param[0])
        elif i==0 and len(param) != 1:
            trimed = rh.Curve.Trim(v, param[1], v.Domain[1])
        else:
            trimed = rh.Curve.Trim(v, param[0], v.Domain[1])
        res.append(trimed)
    return res


class FramePanel:
    niche = 45
    bottom = 45
    top = 35
    diag = 20
    
    bottom_rec = 30
    side_rec = 30
    
    
    @property
    def frame_offset(self):
        self._frame_offset = rh.Curve.JoinCurves(self.all_offset()[0:3])
        return self._frame_offset
    
    @property
    def p_top(self):
        self._p_top= self.all_offset()[3]
        return self._p_top
    
    @property
    def frame_all(self):
        self._frame_all = rh.Curve.JoinCurves(self.all_offset())
        return self._frame_all
    
    @property
    def bound_frame(self):
        rec = bound_rec(self.frame_all)
        min_transl = rh.Point3d(rec.Min[0] - FramePanel.side_rec, rec.Min[1] - FramePanel.bottom_rec, 0)
        self._bound_frame = rh.Rectangle3d(rh.Plane.WorldXY, min_transl, rec.Max)
        return self._bound_frame
        
    def __init__(self, panel):
        self.panel = panel
        self.p_niche = self.panel.fres[1]
        self.p_bottom = self.panel.fres[0]
        
    def all_offset(self):
        niche = offset(self.p_niche, FramePanel.niche, extend=[self.p_niche.Domain[0]+200, self.p_niche.Domain[1]-200])

        if niche is None:
            niche = offset(self.p_niche, FramePanel.niche, extend=[self.p_niche.Domain[0]-200, self.p_niche.Domain[1]+200])

        bottom = offset(self.p_bottom, FramePanel.bottom, extend=[self.p_bottom.Domain[0]-200, self.p_bottom.Domain[1]])
        top_s = self.top_side()
        top = offset(self.top_side(), FramePanel.top, extend=[top_s.Domain[0], top_s.Domain[1]+200])
        diag = offset(self.diag_side(), FramePanel.diag)

        all_offset = [bottom, diag, niche, top]
        
        all_offset = intersect(all_offset)
        return all_offset

        
    def top_side(self):
        bound = bound_rec(self.panel.fres)
        top_side = bound.GetEdges()[2]
        return top_side.ToNurbsCurve()
        
    def diag_side(self):
        st = self.panel.niche.top_part.PointAtEnd
        en = self.panel.side[0].top_part.PointAtStart
        p = self.panel.niche.fres.PointAtEnd
        
        crv = rh.Line.ToNurbsCurve(rh.Line(st, en))
        
        crv_d = crv.PointAtLength(rh.Curve.DivideByCount(crv, 2, False)[0])
        FramePanel.diag = rh.Point3d.DistanceTo(p, crv_d) + 10
        return crv


    
FramePanel.niche = niche
FramePanel.bottom = bottom
FramePanel.top = top
aa = FramePanel(panel)

#a = aa.all_offset()
a = aa.bound_frame
frame = aa.frame_offset
# ---------- end python_7 ----------
python_8 = GhPythonScript(panel=item_20, niche=number_slider_5, bottom=number_slider_5, top=Slider(35, range=0..100))  # -> out, a, flatten(frame); same code as python_7
panel_7 = Panel(python_7.frame)
item_22 = ListItem(List=python_7.a, Index=0, Wrap=True)  # -> flatten(Item)
item_23 = ListItem(List=python_7.frame, Index=0, Wrap=True)  # -> flatten(Item)
previewlw_8 = CustomPreviewLineweights(Geometry=item_22, Shader=ColourSwatch(SwatchColor=RGB(0, 81, 255)), Thickness=Slider(4, range=0..10), Absolute=False)
previewlw_9 = CustomPreviewLineweights(Geometry=item_23, Shader=ColourSwatch(SwatchColor=RGB(0, 191, 255)), Thickness=Slider(3, range=0..10), Absolute=False)
